# Grasshopper definition Grasshopper pts.gh (Grasshopper 1.0.7)
# plug-ins: Human

path = FilePath("C:\Users\vince\Dropbox\RC 15 Skills 2023\Module 01 - Sensing\Day 02 - Visualising the Results\02 Export Qgis to Rhino\004RC16S.csv")
file = ReadFile(File=path, PerLineParse=True)
cull_i = CullIndex(List=file, Indices=0, Wrap=True)
split = TextSplit(Text=cull_i, Separators=",")
panel = Panel(split)
panel_2 = Panel(cull_i)
item = ListItem(List=split, Index="0", Wrap=True)  # -> graft(Item), graft(Item1)
item_2 = ListItem(List=split, Index="9", Wrap=True)  # -> simplify(Item)
bnd = Bounds(Numbers=flatten(item_2))
pt = ConstructPoint(XCoordinate=item.Item, YCoordinate=item.Item1, ZCoordinate=item_2)
dedomain = DeconstructDomain(Domain=bnd)  # -> Start, End
gradient = Gradient(
    LowerLimit=dedomain.Start,
    UpperLimit=dedomain.End,
    Parameter=item_2,
    stops=[0: RGB(0, 128, 0), 0.5: RGB(255, 255, 0), 1: RGB(255, 0, 0)])
preview = CustomPreview(Geometry=pt, Material=gradient)
createatts = CreateAttributes(Color=gradient, enableFullPath=False)
bake = BakeGeometry(Bake=Toggle(False), Geometry=pt, Attributes=createatts, DeleteOldBakes=False, PreserveTrees=False)
