# Grasshopper definition Heatmap 3D.gh (Grasshopper 1.0.7)
# plug-ins: Human

number_slider = Slider(90, range=0..100)
geo = Geometry(<brep referenced from the Rhino model>)
sdivide = DivideSurface(Surface=reparameterize(geo), UCount=number_slider, VCount=Slider(68, range=0..100))  # -> simplify(Points), Normals, Parameters
image = ImageSampler(
    sdivide.Parameters,
    FilePath="C:\Users\vince\Dropbox\RC 15 Skills 2023\Module 01 - Sensing\Day 02 - Visualising the Results\02 Export Qgis to Rhino\Heatmap_clipped.png",
    Filter="Value",
    Interpolate=True,
    Umax=1,
    Umin=0,
    Vmax=1,
    Vmin=0,
    Wrap=1)
panel = Panel(image)
panel_2 = Panel(sdivide.Points)
Z = UnitZ(Factor=image)
graph = GraphMapper(image, x0=0, x1=1, y0=0, y1=1, container_name="Bezier", cpx=[0, 0.4576659203, 0.5512752533, 1], cpy=[0, 0, 1, 1])
multiplication = Multiplication(A=Z, B=Slider(500, range=0..500))
move = Move(Geometry=sdivide.Points, Motion=multiplication)  # -> Geometry, Transform
srfgrid = SurfaceFromPoints(Points=flatten(move.Geometry), UCount=expr("x+1", number_slider), Interpolate=False)
series = Series(Start=0, Step="10", Count="150")
xy = XYPlane(Origin=Point(0, 0, 0))
contour = ContourEx(Shape=srfgrid, Plane=xy, Offsets=series)
eval = EvaluateCurve(Curve=contour, Parameter=0)  # -> Point, Tangent, Angle
pdecon = Deconstruct(Point=flatten(eval.Point))  # -> XComponent, YComponent, ZComponent
bnd = Bounds(Numbers=pdecon.ZComponent)
dedomain = DeconstructDomain(Domain=bnd)  # -> Start, End
gradient = Gradient(
    LowerLimit=dedomain.End,
    UpperLimit=dedomain.Start,
    Parameter=pdecon.ZComponent,
    stops=[0: RGB(234, 38, 0), 0.25: RGB(234, 126, 0), 0.5: RGB(254, 244, 84), 0.75: RGB(173, 203, 249), 1: RGB(75, 107, 169)])
preview = CustomPreview(Geometry=flatten(contour), Material=gradient)
createatts = CreateAttributes(Color=gradient, GroupIndices="1", enableFullPath=False)
bake = BakeGeometry(Bake=Button(), Geometry=flatten(contour), Attributes=createatts, DeleteOldBakes=False, PreserveTrees=False)
