# Grasshopper definition Reading Arduino Live.gh (Grasshopper 1.0.7)
# plug-ins: Firefly.Core

ports_available = COMPortsAvailable()
trigger = Trigger(Interval=10, TimerInterval=10, Target=[read, time])
read = SerialReadGeneric(StartReadingValues=Toggle(True), PortNumber=ports_available)  # -> SerialOutput, StatusMessage
panel = Panel(ports_available)
time = Time("now")
open_port = OpenClosePort(OpenClosePort=Toggle(True), PortNumber=ports_available, BaudRate="9600")
button = Button()
panel_2 = Panel(read.SerialOutput)
panel_3 = Panel(read.StatusMessage)
panel_4 = Panel(time)
panel_5 = Panel(open_port)
log = DataLog(IncomingData=read.SerialOutput, ResetLog=button, StartRecording=True, WrapValues=Toggle(True), RecordingLength="1000")
path = FilePath("C:\Users\vince\Dropbox\RC 15 Skills 2023\Module 01 - Sensing\Day 02 - Visualising the Results\05 Reading Arduino From Grasshopper\Reading Arduino Live.txt")
concat = Concatenate(FragmentA=panel_2, FragmentB=",", FragmentC=panel_4)
log_2 = DataLog(
    IncomingData=concat,
    ResetLog=button,
    StartRecording=True,
    WrapValues=False,
    RecordingLength="1000",
    OptionalFilePath=path)
panel_6 = Panel(log_2)
x_axis = Geometry(<curve referenced from the Rhino model>)
panel_7 = Panel(log)
remap = RemapNumbers(Value=log, Source="200 To 600", Target="0 To 50")  # -> graft(Mapped), Clipped
divide = DivideCurve(Curve=x_axis, Count="1000", Kinks=False)  # -> Points, Tangents, Parameters
Y = UnitY(Factor=remap.Mapped)
panel_8 = Panel(Y)
move = Move(Geometry=graft(divide.Points), Motion=Y)  # -> flatten(Geometry), Transform
pline = PolyLine(Vertices=move.Geometry, Closed=False)
