# Grasshopper definition Grasshopper Rose.gh (Grasshopper 1.0.7)

path = FilePath("C:\Users\vince\Dropbox\RC 15 Skills 2023\Module 01 - Sensing\Day 02 - Visualising the Results\Grasshopper Rose\001RC18X.CSV")
file = ReadFile(File=path, PerLineParse=True)
cull_i = CullIndex(List=file, Indices=0, Wrap=True)
split = TextSplit(Text=cull_i, Separators="\t")
panel = Panel(split)
item = ListItem(List=split, Index="7", Wrap=True)  # -> flatten(Item)
tstat = TreeStatistics(Tree=item)  # -> Paths, Length, simplify(Count)
panel_2 = Panel(item)
panel_3 = Panel(tstat.Length)
panel_4 = Panel(cull_i)
panel_5 = Panel(panel_3)
cir = Circle(Plane=PlaneXY(0, 0, 0), Radius=1)
pframes = PerpFrames(Curve=cir, Count=panel_5, Align=True)  # -> Frames, Parameters
rad = Radians(Degrees=Slider(29, range=0..90))
random = Random(Range=Domain(0, 1), Number=panel_5, Seed=2)
prot = RotatePlane(Plane=pframes.Frames, Angle=rad)
deplane = DeconstructPlane(Plane=pframes.Frames)  # -> Origin, XAxis, YAxis, ZAxis
deplane_2 = DeconstructPlane(Plane=prot)  # -> Origin, XAxis, YAxis, ZAxis
multiplication = Multiplication(A=deplane_2.YAxis, B=panel_2)
multiplication_2 = Multiplication(A=multiplication, B=Slider(0.01, range=0..3))
move = Move(Geometry=deplane_2.Origin, Motion=multiplication_2)  # -> Geometry, Transform
nurbs = NurbsCurve(Vertices=deplane.Origin, Degree=3, Periodic=True)  # -> Curve, Length, Domain
nurbs_2 = NurbsCurve(Vertices=move.Geometry, Degree=3, Periodic=True)  # -> Curve, Length, Domain
loft = Loft(
    Curves=[nurbs.Curve, nurbs_2.Curve],
    Options={Adjust=False, Closed=False, LoftEnds=0, LoftSimp=0, LoftType=0, Rebuild=10, Refit=0.01})
div = DivideDomain(Domain=Domain(0, 1), Count=10)
range = Range(Domain=Domain(0, 1), Steps=Slider(5, range=0..20))
range_2 = Range(Domain=Domain(0, 1), Steps=Slider(8, range=0..20))
pt = ConstructPoint(XCoordinate=range, YCoordinate=range_2, ZCoordinate=0)
iso = IsoCurve(Surface=reparameterize(loft), UVPoint=pt)  # -> UIsocurve, VIsocurve
crv = Curve(flatten(iso.VIsocurve))
len = Length(Curve=crv)
bnd = Bounds(Numbers=len)
dedomain = DeconstructDomain(Domain=bnd)  # -> Start, End
panel_6 = Panel(crv)
gradient = Gradient(
    LowerLimit=dedomain.Start,
    UpperLimit=dedomain.End,
    Parameter=len,
    stops=[0: RGB(0, 128, 0), 0.5: RGB(255, 255, 0), 1: RGB(255, 0, 0)])
preview = CustomPreview(Geometry=crv, Material=gradient)
