# Grasshopper definition Shapefiles.gh (Grasshopper 1.0.7)

path = FilePath("C:\Users\vince\Dropbox\RC 15 Skills 2023\Module 02 - Datamining\Day 01 - Mining Open Data\Excercise 01 - Noise\Road_LAeq_16h_London\Road_LAeq_16h_London.shp")
path_2 = FilePath("C:\Users\vince\Dropbox\RC 15 Skills 2023\Module 02 - Datamining\Day 01 - Mining Open Data\Excercise 01.1 - Greater London\greater-london-latest-free.shp\gis_osm_buildings_a_free_1.dbf")
shp = ImportSHP(File=path)  # -> Points, Curves, Regions
shp_2 = ImportSHP(File=path_2)  # -> Points, Curves, Regions
