# Grasshopper definition Elk.gh (Grasshopper 1.0.7)
# plug-ins: ElkGHComponents

file_path = FilePath("C:\Users\vince\Dropbox\RC 15 Skills 2023\Module 02 - Datamining\Day 01 - Mining Open Data\Day 2 Example 07 - Elk\Zuerich Sea and Mountains.osm")
location = Location(FilePathText=file_path)  # -> OSMPointData, OSMFile, LongitudeDomain, LatitudeDomain
# This element operates in three steps:
# 
# 1. Initially, you are required to acquire the osm file from Openstreetmaps and store it in a designated location on your hard drive.
# 2. Within grasshopper, you establish a file path indicating the location of your osm file. This path is then connected to the ELK LOCATION COMPONENT, which reads the file and returns basic data, such as the map coordinates.
# 3. From this component, you establish a connection to the OSM Data Component. By right-clicking within the component, you can select the specific type of feature you wish to showcase, along with the corresponding subfeatures. In the event that Buildings possess 3D data in Openstreetmaps, they will be displayed; otherwise, a simple plane will be generated. Additionally, one of the outputs is a vital component that contains supplementary details regarding the features.
panel = Panel(file_path)
file_path_2 = FilePath("C:\Users\vince\Dropbox\RC 15 Skills 2023\Module 02 - Datamining\Day 01 - Mining Open Data\Day 2 Example 07 - Elk\n47_e008_3arc_v2.tif")

osm_data = OSMData(
    OSMPointData=location.OSMPointData,
    OSMFilePath=location.OSMFile,
    Feature="building",
    Generate3d=True,
    IndividualOutputs=False,
    SelectedTypes=["commercial", "retail"])  # -> Ways, Buildings, FeatureKey
osm_data_2 = OSMData(
    OSMPointData=location.OSMPointData,
    OSMFilePath=location.OSMFile,
    Feature="building",
    Generate3d=True,
    IndividualOutputs=False,
    SelectedTypes=["cathedral", "chapel", "church", "mosque", "shrine", "synagogue", "temple"])  # -> Ways, Buildings, FeatureKey
osm_data_3 = OSMData(
    OSMPointData=location.OSMPointData,
    OSMFilePath=location.OSMFile,
    Feature="building",
    Generate3d=True,
    IndividualOutputs=False,
    SelectedTypes=["school", "university"])  # -> Ways, Buildings, FeatureKey
osm_data_4 = OSMData(
    OSMPointData=location.OSMPointData,
    OSMFilePath=location.OSMFile,
    Feature="highway",
    Generate3d=False,
    IndividualOutputs=False)  # -> Ways, FeatureKey
osm_data_5 = OSMData(
    OSMPointData=location.OSMPointData,
    OSMFilePath=location.OSMFile,
    Feature="natural",
    Generate3d=False,
    IndividualOutputs=False,
    SelectedTypes="water")  # -> Ways, FeatureKey
osm_data_6 = OSMData(
    OSMPointData=location.OSMPointData,
    OSMFilePath=location.OSMFile,
    Feature="natural",
    Generate3d=False,
    IndividualOutputs=False,
    SelectedTypes=["grassland", "tree", "tree_row", "wood"])  # -> Ways, FeatureKey
osm_data_7 = OSMData(
    OSMPointData=location.OSMPointData,
    OSMFilePath=location.OSMFile,
    Feature="building",
    Generate3d=False,
    IndividualOutputs=False)  # -> Ways, FeatureKey
polyline = PolyLine(Vertices=osm_data_4.Ways, Closed=False)
polyline_2 = PolyLine(Vertices=osm_data_5.Ways, Closed=False)
polyline_3 = PolyLine(Vertices=osm_data_6.Ways, Closed=True)
boundary_surfaces = BoundarySurfaces(Edges=polyline_3)
polyline_4 = PolyLine(Vertices=osm_data_7.Ways, Closed=True)
create_material = CreateMaterial(
    Diffuse=ColourSwatch(SwatchColor=RGB(26, 26, 26)),
    Specular=RGB(255, 255, 255),
    Emission=RGB(0, 0, 0),
    Transparency=0.5,
    Shine=0)
custom_preview = CustomPreview(Geometry=polyline_4, Shader=create_material)
custom_preview_2 = CustomPreview(Geometry=polyline, Shader=ColourSwatch(SwatchColor=RGB(242, 223, 17)))
custom_preview_3 = CustomPreview(Geometry=osm_data.Buildings, Shader=ColourSwatch(SwatchColor=RGB(235, 199, 232)))
custom_preview_4 = CustomPreview(Geometry=osm_data_2.Buildings, Shader=ColourSwatch(SwatchColor=RGB(199, 235, 218)))
custom_preview_5 = CustomPreview(Geometry=osm_data_3.Buildings, Shader=ColourSwatch(SwatchColor=RGB(199, 204, 235)))
custom_preview_6 = CustomPreview(Geometry=boundary_surfaces, Shader=ColourSwatch(SwatchColor=RGB(51, 242, 17)))
custom_preview_7 = CustomPreview(Geometry=polyline_2, Shader=ColourSwatch(SwatchColor=RGB(17, 47, 242)))

topography = Topography(FilePath=file_path_2, Longitude=location.LongitudeDomain, Latitude=location.LatitudeDomain)  # -> FileInfo, Points, Curves, Surface
# http://earthexplorer.usgs.gov/
panel_2 = Panel(file_path_2)
surface = Surface(reparameterize(topography.Surface))

# ---- group: Project Lines onto Topo Surface
unit_z = UnitZ(Factor=1)
curve = Curve(polyline_4)
project = Project(Curve=curve, Brep=surface, Direction=unit_z)

# ---- group: Topo Lines
contour = Contour(Shape=surface, Point=Point(0, 0, 0), Direction=Vector(0, 0, 1), Distance="10")
