# Grasshopper definition Mosquito.gh (Grasshopper 1.0.7)
# plug-ins: MosquitoEXIF, MosquitoFlicker, Mosquito

# This one allows you to download flicker.
# We search for "party" pictures in Soho...
panel = Panel("party")
# And the same for twitter ...
panel_2 = Panel("party")
# Exif is the attached metadata to a photo file.
# You can extract them like below:
path = FilePath("D:\Dropbox\RC15 Skills 2022\Skills 01 - Geospatial Data\Skills 01 - WIP\Day 2 Example 10 - Mosquito\Exif\")
flicker = MosquitoFlicker(Search=panel, Latitude="51.513817481903146", Longitude="-0.13468401237090186", Radius="2")  # -> User, Title, Date, GeoPoint, Info, URL, sURL, IDs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
# Mosquito is one of the plug-ins where only half of it works.
# Anything that uses some sort of commercial proprietary
# rights needs maintenance and is prone to failure.
# This is the case here. Facebook and google are not working
# - osm, twitter & flickr do work.In any case, please try.
# 
# Please try - this plug in is some sort of a mixed bag.
exif = EXIF(String=path)  # -> Title, Date, Latitude, Longitude, Altitude, Author, Aperture, Brightness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
twitter = SonicTweet(Search=panel_2, GeoLat="51.513817481903146", GeoLon="-0.13468401237090186", GeoRadius="2")  # -> Message, fromUser, toUser, Date, Location, hasGeo, ProfilePic, Followers, ID
panel_3 = Panel(exif.Title)
panel_4 = Panel(exif.Latitude)
panel_5 = Panel(exif.Device)
panel_6 = Panel(flicker.User)
panel_7 = Panel(flicker.URL)
panel_8 = Panel(exif.Date)
panel_9 = Panel(exif.Longitude)
# ... and a bit more advanced...
python = GhPythonScript(index="0", messages=twitter.Message, fromUsers=twitter.fromUser, dates=twitter.Date)  # -> out, message, fromUser, date; inputs index: Int32, messages: list, fromUsers: list, dates: list
# ---------- python: Python ----------
__author__ = "vince"
__version__ = "2022.11.13"

import rhinoscriptsyntax as rs


message = messages[index]
fromUser = fromUsers[index]
date = dates[index]
# ---------- end python ----------
# ... the alternative to the above component in python ...
python_2 = GhPythonScript(list=twitter.fromUser, index="0")  # -> out, a; inputs list: list, index: Int32
# ---------- python_2: Python ----------
__author__ = "vince"
__version__ = "2022.11.13"

import rhinoscriptsyntax as rs


a = list[index]
# ---------- end python_2 ----------
item = ListItem(List=twitter.Message, Index="0", Wrap=True)
item_2 = ListItem(List=panel_7, Index="73", Wrap=True)
item_3 = ListItem(List=flicker.Pages, Index="73", Wrap=True)
item_4 = ListItem(List=flicker.Info, Index="73", Wrap=True)
item_5 = ListItem(List=flicker.sURL, Index="73", Wrap=True)
item_6 = ListItem(List=flicker.IDs, Index="73", Wrap=True)
panel_10 = Panel(item)
panel_11 = Panel(python_2.a)
panel_12 = Panel(item_4)
panel_13 = Panel(item_2)
panel_14 = Panel(item_3)
panel_15 = Panel(item_5)
panel_16 = Panel(item_6)
panel_17 = Panel(python.message)
panel_18 = Panel(python.date)
panel_19 = Panel(python.fromUser)
